# Grasshopper definition CoordinateProjection.gh (Grasshopper 1.0.7)

number_slider = Slider(18, range=0..100)
latlon_to_tile = GhPythonScript(lat=Slider(35.69846, range=0..100), lon=Slider(139.72756, range=0..1000), z=number_slider)  # -> out, x, y; inputs z: Int32
# ---------- latlon_to_tile: Python ----------
import rhinoscriptsyntax as rs

from math import log
from math import tan
from math import pi

if lon is not None and lat is not None and z is not None:
    x = int((lon / 180 + 1) * 2**z / 2)
    y = int(((-log(tan((45 + lat / 2) * pi / 180)) + pi) * 2**z / (2 * pi)))
# ---------- end latlon_to_tile ----------
tile_to_lanlon = GhPythonScript(x=latlon_to_tile.x, y=latlon_to_tile.y, z=number_slider)  # -> out, lat, lon; inputs x: Int32, y: Int32, z: Int32
# ---------- tile_to_lanlon: Python ----------
import rhinoscriptsyntax as rs

from math import pi
from math import e
from math import atan

if x is not None and y is not None and z is not None:
    lon = (x / 2.0**z) * 360 - 180
    mapy = (y / 2.0**z) * 2 * pi - pi
    lat = 2 * atan(e ** (- mapy)) * 180 / pi - 90
# ---------- end tile_to_lanlon ----------
panel = Panel(latlon_to_tile.y)
number_slider_2 = Slider(233078, range=0..1000000)
panel_2 = Panel(latlon_to_tile.x)
number_slider_3 = Slider(102845, range=0..1000000)
panel_3 = Panel(tile_to_lanlon.lat)
panel_4 = Panel(tile_to_lanlon.lon)
python = GhPythonScript(x=latlon_to_tile.x, y=latlon_to_tile.y, z=number_slider, t=Slider(3, range=0..10), run=Toggle(True))  # -> out, json; inputs x: Int32, y: Int32, z: Int32, t: Int32, run: Boolean
# ---------- python: Python ----------
import rhinoscriptsyntax as rs
from System.Net import HttpWebRequest
from System.IO import StreamReader
import clr
clr.AddReference('System.Web.Extensions')
from System.Web.Script.Serialization import JavaScriptSerializer

if run:
    dict = {"features": []}
    for i in range(t):
        for n in range(t):
            apiurl = "https://cyberjapandata.gsi.go.jp/xyz/experimental_fgd/{0}/{1}/{2}.geojson"
            uri = apiurl.format(z,x+i,y+n)
            webRequest = HttpWebRequest.Create(uri)
            webRequest.Timeout=1000
            with webRequest.GetResponse() as response:
            
                streamReader = StreamReader(response.GetResponseStream())
                jsonData = streamReader.ReadToEnd()
                js = JavaScriptSerializer()
                dataDict = js.DeserializeObject(jsonData)
                dict["features"].extend(dataDict["features"])
                
    json = js.Serialize(dict)
# ---------- end python ----------
path = FilePath("/Users/jhorikawa/odrive/Google Drive/JH/Projects/[254] AECTech2021/GISwithPython/lib/")
python_2 = GhPythonScript(json=python.json, run=Toggle(False))  # -> out, a; inputs run: Boolean
# ---------- python_2: Python ----------
import rhinoscriptsyntax as rs
import Rhino.Geometry as geo

import clr
clr.AddReference('System.Web.Extensions')
from System.Web.Script.Serialization import JavaScriptSerializer
from System.Net import HttpWebRequest
from System.IO import StreamReader

if run:
    polylines = []
    uribase = "https://geodesy.noaa.gov/api/ncat/llh?lat={0}&lon={1}&eht=100.0&inDatum=nad83(1986)&outDatum=nad83(2011)"

    if json is not None:
        js = JavaScriptSerializer()
        dataDict = js.DeserializeObject(json)
        
        features = dataDict["features"]
        for feature in features:
            type = feature["properties"]["class"]
            coords = feature["geometry"]["coordinates"]
            if "BldL" in type:
                points = []
                for coord in coords:
                    lat = coord[1]
                    lon = coord[0]
                    uri = uribase.format(lat, lon)
                    webRequest = HttpWebRequest.Create(uri)
                    webRequest.Timeout=5000
                    with webRequest.GetResponse() as response:
                        streamReader = StreamReader(response.GetResponseStream())
                        jsonData = streamReader.ReadToEnd()
                        coordDict = js.DeserializeObject(jsonData)
                        
                        
                        north = coordDict["utmNorthing"]
                        east = coordDict["utmEasting"]
                        
                        pos = geo.Point3d(float(east.replace(',','')), 0, float(north.replace(',','')))
                        points.append(pos)
                polyline = rs.AddPolyline(points)
                polylines.append(polyline)
    a = polylines
# ---------- end python_2 ----------
python_3 = GhPythonScript(libdir=path, json=python.json)  # -> out, bld, rdg
# ---------- python_3: Python ----------
import sys
import rhinoscriptsyntax as rs
import Rhino.Geometry as geo
import clr

if libdir not in sys.path:
    sys.path.append(libdir)


clr.AddReference('ProjNet')
clr.AddReference('GeoAPI.CoordinateSystems')
clr.AddReference('System.Web.Extensions')
from System.Web.Script.Serialization import JavaScriptSerializer

from ProjNet import *
from ProjNet.CoordinateSystems import *
from ProjNet.CoordinateSystems.Transformations import *
from GeoAPI.CoordinateSystems import *
from GeoAPI.CoordinateSystems.Transformations import *

#### get utm zone function
def zone(coordinates):
    if 56 <= coordinates[1] < 64 and 3 <= coordinates[0] < 12:
        return 32
    if 72 <= coordinates[1] < 84 and 0 <= coordinates[0] < 42:
        if coordinates[0] < 9:
            return 31
        elif coordinates[0] < 21:
            return 33
        elif coordinates[0] < 33:
            return 35
        return 37
    return int((coordinates[0] + 180) / 6) + 1

#### get utm letter function
def letter(coordinates):
    return 'CDEFGHJKLMNPQRSTUVWXX'[int((coordinates[1] + 80) / 8)]

#### convert longitude latitude to utm function
def LLtoUTM(coordinates):
    z = zone(coordinates)
    l = letter(coordinates)
    ctfac = CoordinateTransformationFactory()

    wgs84 = CoordinateSystems.GeographicCoordinateSystem.WGS84
    utm = CoordinateSystems.ProjectedCoordinateSystem.WGS84_UTM(z, coordinates[1] > 0)
    trans = ctfac.CreateFromCoordinateSystems(wgs84, utm)

    result = trans.MathTransform.Transform(coordinates);
    x = result[0]
    y = result[1]
    return z, l, x, y
    

if json is not None:
    bldPolylines = []
    rdgPolylines = []
    
    js = JavaScriptSerializer()
    dataDict = js.DeserializeObject(json)
    
    avepos = geo.Point3d(0,0,0)
    count = 0
    
    features = dataDict["features"]
    for feature in features:
        type = feature["properties"]["class"]
        coords = feature["geometry"]["coordinates"]
        if "BldL" in type or "RdEdg" in type:
            points = []
            for coord in coords:
                
                z, l, x, y = LLtoUTM((float(coord[0]), float(coord[1])))
                pt = geo.Point3d(x, y, 0)
                points.append(pt)
                count += 1
                avepos += pt
            
            polyline = rs.AddPolyline(points)
            if "BldL" in type:
                bldPolylines.append(polyline)
            elif "RdEdg" in type:
                rdgPolylines.append(polyline)
            
    avepos /= float(count)
    
    movedBldPolylines = []
    movedRdgPolylines = []
    for polyline in bldPolylines:
        mpolyline = rs.MoveObject(polyline, -avepos)
        movedBldPolylines.append(mpolyline)
    for polyline in rdgPolylines:
        mpolyline = rs.MoveObject(polyline, -avepos)
        movedRdgPolylines.append(mpolyline)
        
    bld = movedBldPolylines
    rdg = movedRdgPolylines
# ---------- end python_3 ----------
join = JoinCurves(Curves=python_3.bld, Preserve=False)
join_2 = JoinCurves(Curves=python_3.rdg, Preserve=False)
crv = Curve(join_2)
crv_2 = Curve(join)
preview = CustomPreview(Geometry=crv_2, Material=ColourSwatch(SwatchColor=RGB(255, 36, 36)))
preview_2 = CustomPreview(Geometry=crv, Material=ColourSwatch(SwatchColor=RGB(0, 0, 0)))
