# Grasshopper definition CoordinateProjection2.gh (Grasshopper 1.0.7)

python = GhPythonScript(lat=Slider(35.6875668, range=0..100), lon=Slider(139.7774445, range=0..1000), z="18")  # -> out, x, y; inputs z: Int32
# ---------- python: Python ----------
import rhinoscriptsyntax as rs

from math import log
from math import tan
from math import pi

if lon is not None and lat is not None and z is not None:
    x = int((lon / 180 + 1) * 2**z / 2)
    y = int(((-log(tan((45 + lat / 2) * pi / 180)) + pi) * 2**z / (2 * pi)))
# ---------- end python ----------
panel = Panel(python.x)
panel_2 = Panel(python.y)
python_2 = GhPythonScript(x=python.x, y=python.y, z="18", t=Slider(2, range=1..6), run=Toggle(True))  # -> out, json; inputs x: Int32, y: Int32, z: Int32, t: Int32, run: Boolean
# ---------- python_2: Python ----------
import rhinoscriptsyntax as rs

### Rest APIを利用するための.NET系ライブラリをインポート
from System.Net import HttpWebRequest
from System.IO import StreamReader
### JSON形式を扱うための.NET系ライブラリをインポート
import clr
clr.AddReference('System.Web.Extensions')
from System.Web.Script.Serialization import JavaScriptSerializer


if run:
    dict = {"features": []}
    for i in range(t):
        for n in range(t):
    
            apiurl = "https://cyberjapandata.gsi.go.jp/xyz/experimental_fgd/{0}/{1}/{2}.geojson"
            uri = apiurl.format(z, x+i, y+n)
            
            webRequest = HttpWebRequest.Create(uri)
            webRequest.Timeout=1000
            with webRequest.GetResponse() as response:
            
                streamReader = StreamReader(response.GetResponseStream())
                jsonData = streamReader.ReadToEnd()
                
                js = JavaScriptSerializer()
                dataDict = js.DeserializeObject(jsonData)
                
                array = dataDict["features"]
                dict["features"].extend(array)
                
    json = js.Serialize(dict)
# ---------- end python_2 ----------
path = FilePath("/Users/jhorikawa/odrive/Google Drive/JH/Projects/[194] TokyoAECIndustryDevGroupMeetup/JH Meetups/Coordinate Projection with GHPython/lib/")
panel_3 = Panel(path)
python_3 = GhPythonScript(libdir=path, json=python_2.json)  # -> out, buildings, roads
# ---------- python_3: Python ----------
import rhinoscriptsyntax as rs
import clr
clr.AddReference('System.Web.Extensions')
from System.Web.Script.Serialization import JavaScriptSerializer

import sys
if libdir not in sys.path:
    sys.path.append(libdir)
    
clr.AddReference('ProjNet')
clr.AddReference('GeoAPI.CoordinateSystems')
from ProjNet import *
from ProjNet.CoordinateSystems import *
from ProjNet.CoordinateSystems.Transformations import *
from GeoAPI.CoordinateSystems import *
from GeoAPI.CoordinateSystems.Transformations import *

import Rhino.Geometry as geo

### ProjNetを使った座標変換系の関数を作ります。
### 6経度ずつ分割されたゾーン情報を取得する関数。
def zone(coordinates):
    if 56 <= coordinates[1] < 64 and 3 <= coordinates[0] < 12:
        return 32
    if 72 <= coordinates[1] < 84 and 0 <= coordinates[0] < 42:
        if coordinates[0] < 9:
            return 31
        elif coordinates[0] < 21:
            return 33
        elif coordinates[0] < 33:
            return 35
        return 37
    return int((coordinates[0] + 180) / 6) + 1

### ８緯度ずつ水平分割したときのバンド番号を取得する関数。
def letter(coordinates):
    return 'CDEFGHJKLMNPQRSTUVWXX'[int((coordinates[1] + 80) / 8)]

### 緯度経度をUTM座標に変換する関数。
def LLtoUTM(coordinates):
    z = zone(coordinates)
    l = letter(coordinates)
    ctfac = CoordinateTransformationFactory()

    wgs84 = CoordinateSystems.GeographicCoordinateSystem.WGS84
    utm = CoordinateSystems.ProjectedCoordinateSystem.WGS84_UTM(z, coordinates[1] > 0)
    trans = ctfac.CreateFromCoordinateSystems(wgs84, utm)

    result = trans.MathTransform.Transform(coordinates);
    x = result[0]
    y = result[1]
    return z, l, x, y



if json is not None:
    js = JavaScriptSerializer()
    dataDict = js.DeserializeObject(json)
    
    bldPolylines = []
    rdPolylines = []
    features = dataDict["features"]
    for feature in features:
        coords = feature["geometry"]["coordinates"]
        type = feature["properties"]["class"]
        
        points = []
        for coord in coords:
            
            try:
                coordarray = (float(coord[0]), float(coord[1]))
                z, l, x, y = LLtoUTM(coordarray)
            
                pt = geo.Point3d(x, y, 0)
                points.append(pt)
            except:
                pass
            
        polyline = rs.AddPolyline(points)
        
        if "BldL" in type:
            bldPolylines.append(polyline)
        elif "RdEdg" in type:
            rdPolylines.append(polyline)
    
    buildings = bldPolylines
    roads = rdPolylines
# ---------- end python_3 ----------
crv = Curve(python_3.buildings)
crv_2 = Curve(python_3.roads)
join = JoinCurves(Curves=crv, Preserve=False)
join_2 = JoinCurves(Curves=crv_2, Preserve=False)
merge = Merge(Data1=join, Data2=join_2)
bbox = BoundingBox(Content=merge, Plane=PlaneXY(0, 0, 0), UnionBox=True)  # -> Box, Box_2
panel_4 = Panel(crv)
area = Area(Geometry=bbox.Box)  # -> Area, Centroid
number_slider = Slider(10, range=0..10)
neg = Negative(Value=area.Centroid)
move = Move(Geometry=join, Motion=neg)  # -> Geometry, Transform
move_2 = Move(Geometry=join_2, Motion=neg)  # -> Geometry, Transform
boundary = BoundarySurfaces(Edges=move.Geometry)
preview = CustomPreview(Geometry=move_2.Geometry, Material=ColourSwatch(SwatchColor=RGB(255, 0, 149)))
preview_2 = CustomPreview(Geometry=boundary, Material=ColourSwatch(SwatchColor=RGB(17, 0, 255)))
